# Grasshopper definition Rhino_grasshopper_test_senior_design.gh (Grasshopper 0.9.76)
# plug-ins: Firefly.X

http_shapetest_loganstrong_com_serverfil = Text("http://shapetest.loganstrong.com/serverFile.xml")  # "http://shapetest.loganstrong.com/serverFile.xml"
f_documents_grasshopper_test_xml = Text("F:\Documents\grasshopper_test.xml")
timer = Timer(TimerInterval=5000, Target=[xml_search_2, xml_search_4, xml_search_3, xml_search])

# ----
# Frame
number_slider = Slider(71.2, range=0..100)
number_slider_2 = Slider(50, range=24.5..50)
pt = ConstructPoint(XCoordinate=0, YCoordinate=number_slider, ZCoordinate=0)
pt_2 = ConstructPoint(XCoordinate=number_slider_2, YCoordinate=0, ZCoordinate=0)
rec_2pt = Rectangle2Pt(Plane=PlaneXY(0, 0, 0), PointA=pt_2, PointB=pt, Radius=0)  # -> Rectangle, Length

file = ReadFile(File=f_documents_grasshopper_test_xml, PerLineParse=True)
width = Text("width")
height = Text("height")
y = Text("y")
x = Text("x")
xml_search = XMLSearch(FilePath=http_shapetest_loganstrong_com_serverfil, SearchStringS=height)  # -> simplify(XMLElements)
xml_search_2 = XMLSearch(FilePath=http_shapetest_loganstrong_com_serverfil, SearchStringS=x)
xml_search_3 = XMLSearch(FilePath=http_shapetest_loganstrong_com_serverfil, SearchStringS=width)
xml_search_4 = XMLSearch(FilePath=http_shapetest_loganstrong_com_serverfil, SearchStringS=y)
item = CherryPicker(xml_search_3, ListIndex=0, TreePath_path="{0;0;2}")
item_2 = CherryPicker(xml_search, ListIndex=0, TreePath_path="{3}")
item_3 = CherryPicker(xml_search_2, ListIndex=0, TreePath_path="{0;0;0}")
item_4 = CherryPicker(xml_search_4, ListIndex=0, TreePath_path="{0;0;1}")
num = Number(expr("x/100", item))
num_2 = Number(expr("x/100", item_2))

# ----
# Opening
# Location Changer
# Size Changer
number_slider_3 = Slider(48.5, range=0..48.5)
number_slider_4 = Slider(24.5, range=0..24.5)
number_slider_5 = Slider(0.01, range=0.01..1)
number_slider_6 = Slider(0.01, range=0.01..1)
dom = ConstructDomain(DomainStart=0, DomainEnd=num)
dom_2 = ConstructDomain(DomainStart=item_3, DomainEnd=pt_2)
dom_3 = ConstructDomain(DomainStart=item_4, DomainEnd=pt)
dom_4 = ConstructDomain(DomainStart=0, DomainEnd=num_2)
pt_3 = ConstructPoint(XCoordinate=dom_2, YCoordinate=dom_3, ZCoordinate=0)
xy = XYPlane(Origin=pt_3)
scale_nu = ScaleNU(Geometry=rec_2pt.Rectangle, Plane=xy, ScaleX=dom, ScaleY=dom_4, ScaleZ=1)  # -> Geometry, Transform
debrep = DeconstructBrep(Brep=scale_nu.Geometry)  # -> Faces, Edges, Vertices

panel = Panel(item_3)
panel_2 = Panel(num_2)
panel_3 = Panel(item_4)
panel_4 = Panel(num)

# ----
# Horizontal Blinds
debrep_2 = DeconstructBrep(Brep=rec_2pt.Rectangle)  # -> Faces, Edges, Vertices
item_5 = ListItem(List=debrep.Edges, Index=2, Wrap=True)
item_6 = ListItem(List=debrep.Edges, Index=0, Wrap=True)
item_7 = ListItem(List=debrep_2.Edges, Index=2, Wrap=True)
item_8 = ListItem(List=debrep_2.Edges, Index=0, Wrap=True)
line = Line(item_5)
line_2 = Line(item_6)
num_3 = Number(number_slider_2)
num_4 = Number(number_slider_2)
addition = Addition(A=num_3, B=Slider(1, range=1..4))
addition_2 = Addition(A=num_4, B=Slider(1, range=1..4))
division = Division(A=addition)
division_2 = Division(A=addition_2)
X = UnitX(Factor=division)
scale = Scale(Geometry=line, Center=Point(0, 0, 0), Factor=X)  # -> Geometry, Transform
scale_2 = Scale(Geometry=line_2, Center=Point(0, 0, 0), Factor=division_2)  # -> Geometry, Transform
devec = DeconstructVector(Vector=scale.Geometry)  # -> XComponent, YComponent, ZComponent
devec_2 = DeconstructVector()  # -> XComponent, YComponent, ZComponent
devec_3 = DeconstructVector(Vector=scale_2.Geometry)  # -> XComponent, YComponent, ZComponent
devec_4 = DeconstructVector()  # -> XComponent, YComponent, ZComponent
multiplication = Multiplication(A=devec.XComponent, B=-1)
multiplication_2 = Multiplication(A=devec_3.XComponent, B=1)
division_3 = Division(A=multiplication, B=2)
division_4 = Division(B=2)
division_5 = Division(A=multiplication_2, B=2)
division_6 = Division(B=2)
subtraction = Subtraction(A=division_3, B=division_4)
subtraction_2 = Subtraction(A=division_5, B=division_6)
multiplication_3 = Multiplication(A=subtraction, B=-1)
subtraction_3 = Subtraction(A=addition, B=subtraction)
multiplication_4 = Multiplication(A=subtraction_2, B=-1)
subtraction_4 = Subtraction(A=addition_2, B=subtraction_2)
pt_4 = ConstructPoint(XCoordinate=multiplication_3, YCoordinate=devec_2.YComponent, ZCoordinate=0)
pt_5 = ConstructPoint(XCoordinate=subtraction_3, YCoordinate=devec_2.YComponent, ZCoordinate=0)
pt_6 = ConstructPoint(XCoordinate=multiplication_4, YCoordinate=devec_4.YComponent, ZCoordinate=0)
pt_7 = ConstructPoint(XCoordinate=subtraction_4, YCoordinate=devec_4.YComponent, ZCoordinate=0)
ln = Line(StartPoint=pt_4, EndPoint=pt_5)
ln_2 = Line(StartPoint=pt_6, EndPoint=pt_7)
pipe = Pipe(Curve=[ln, ln_2], Radius=Slider(0.2, range=0.1..0.3), Caps=0)

# ----
# Vertical Blinds
debrep_3 = DeconstructBrep(Brep=rec_2pt.Rectangle)  # -> Faces, Edges, Vertices
item_9 = ListItem(List=debrep.Edges, Index=3, Wrap=True)
item_10 = ListItem(List=debrep.Edges, Index=1, Wrap=True)
item_11 = ListItem(List=debrep_3.Edges, Index=3, Wrap=True)
item_12 = ListItem(List=debrep_3.Edges, Index=1, Wrap=True)
line_3 = Line(item_9)
line_4 = Line(item_10)
num_5 = Number(number_slider)
num_6 = Number(number_slider)
addition_3 = Addition(A=num_5, B=Slider(1, range=1..4))
addition_4 = Addition(A=num_6, B=Slider(1, range=1..4))
division_7 = Division(A=addition_3)
division_8 = Division(A=addition_4)
X_2 = UnitX(Factor=division_7)
scale_3 = Scale(Geometry=line_3, Center=Point(0, 0, 0), Factor=X_2)  # -> Geometry, Transform
scale_4 = Scale(Geometry=line_4, Center=Point(0, 0, 0), Factor=division_8)  # -> Geometry, Transform
devec_5 = DeconstructVector(Vector=scale_3.Geometry)  # -> XComponent, YComponent, ZComponent
devec_6 = DeconstructVector()  # -> XComponent, YComponent, ZComponent
devec_7 = DeconstructVector(Vector=scale_4.Geometry)  # -> XComponent, YComponent, ZComponent
devec_8 = DeconstructVector()  # -> XComponent, YComponent, ZComponent
multiplication_5 = Multiplication(A=devec_5.YComponent, B=-1)
multiplication_6 = Multiplication(A=devec_7.YComponent, B=1)
division_9 = Division(A=multiplication_5, B=2)
division_10 = Division(B=2)
division_11 = Division(A=multiplication_6, B=2)
division_12 = Division(B=2)
subtraction_5 = Subtraction(A=division_9, B=division_10)
subtraction_6 = Subtraction(A=division_11, B=division_12)
multiplication_7 = Multiplication(A=subtraction_5, B=-1)
subtraction_7 = Subtraction(A=multiplication_5, B=subtraction_5)
multiplication_8 = Multiplication(A=subtraction_6, B=-1)
subtraction_8 = Subtraction(A=multiplication_6, B=subtraction_6)
pt_8 = ConstructPoint(XCoordinate=devec_6.XComponent, YCoordinate=multiplication_7, ZCoordinate=0)
pt_9 = ConstructPoint(XCoordinate=devec_6.XComponent, YCoordinate=subtraction_7, ZCoordinate=0)
pt_10 = ConstructPoint(XCoordinate=devec_8.XComponent, YCoordinate=multiplication_8, ZCoordinate=0)
pt_11 = ConstructPoint(XCoordinate=devec_8.XComponent, YCoordinate=subtraction_8, ZCoordinate=0)
ln_3 = Line(StartPoint=pt_8, EndPoint=pt_9)
ln_4 = Line(StartPoint=pt_10, EndPoint=pt_11)
pipe_2 = Pipe(Curve=[ln_3, ln_4], Radius=Slider(0.2, range=0.1..0.3), Caps=0)
